# Grasshopper definition plan_to_kuka_src.gh (Grasshopper 1.0.7)
# plug-ins: KUKA|prc - parametric robot control

# ---- group: bar diameter
number = Number("3.17")

# ----
# 1/4 inch OD rod, 3.175 mm radius
# rack start pt
# rack direction pt
# caliberated TCP value
# original TCP
# EE visual mesh
# EE visual mesh
# Y moving distance
# connect escape distance after printing
number_slider = Slider(52.512, range=0..100)
sine = Sine(Value=degrees(number_slider))
division = Division(A=number, B="2")
division_2 = Division(A=division, B=sine)
panel = Panel(division_2)
point = Point(Point(431.62, 408.76, 125.148736))
addition = Addition(A=division_2, B="1")
subtraction = Subtraction(A="52.33", B=Slider(10, range=0..10))
unit_z = UnitZ(Factor=addition)
unit_x = UnitX(Factor=subtraction)
addition_2 = Addition(A=unit_z, B=unit_x)
move = Move(Geometry=point, Motion=addition_2)  # -> Geometry, Transform
point_2 = Point(move.Geometry)
unit_x_2 = UnitX(Factor=1)
point_3 = Point(point_2)
move_2 = Move(Geometry=point_3, Motion=unit_x_2)  # -> Geometry, Transform
point_4 = Point(move_2.Geometry)

# ----
# table model in the origin
brep = Brep(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)

rhino_doc_dir = RhinoDocDir()  # -> rhino_doc_dir
# ---------- rhino_doc_dir: Python ----------
import scriptcontext as sc
from os import path

rhino_doc_dir = path.abspath(path.dirname(sc.doc.Path))
# ---------- end rhino_doc_dir ----------
point_5 = Point("600, 0, -14.23")

# ----
# bar rack
brep_2 = Brep(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)
point_6 = Point("431.62, 421.26, 131.61")

ghpython_script = GhPythonScript(x=rhino_doc_dir)  # -> out, a
# ---------- ghpython_script: Python ----------
import os

a = os.path.join(x, '..', '..', 
    'src\coop_assembly\data\models\kuka_kr6_r900\meshes\mit_arch_grasp_end_effector')
# ---------- end ghpython_script ----------
move_3 = Move(Geometry=brep, Motion=point_5)  # -> Geometry, Transform
ghpython_script_2 = GhPythonScript(
    file_dir=ghpython_script.a,
    collision_file_name="mit_arch_grasp_end_effector_collision.stl",
    virtual_file_name="mit_arch_grasp_end_effector_visual.stl")  # -> out, collision_mesh, virutal_mesh
# ---------- ghpython_script_2: Python ----------
import rhinoscriptsyntax as rs
import Rhino.Geometry.Plane as Plane
import Rhino.Geometry.Point3d as Point3d
import Rhino.Geometry.Vector3d as Vector3d
import Rhino.Geometry.Quaternion as Quat
import Grasshopper.DataTree as DataTree # Add, AddRange(list, GHPath(i, j))
import Grasshopper.Kernel.Data.GH_Path as GHPath
import System

from ghpythonlib.treehelpers import list_to_tree, tree_to_list

#import json
#from compas.geometry import Frame
#from compas_ghpython import draw_pipes, draw_frame

import compas
from compas.datastructures import Mesh
from compas_ghpython.artists import MeshArtist
import os

collision_fp = os.path.join(file_dir, 'collision', collision_file_name)
#virtual_fp = os.path.join(file_dir, 'visual', virtual_file_name)

collision_cp_mesh = Mesh.from_stl(collision_fp)
#virtual_cp_mesh = Mesh.from_stl(virtual_fp)

collision_mesh = MeshArtist(collision_cp_mesh).draw_mesh()
#virtual_mesh = MeshArtist(virtual_cp_mesh).draw_vertices()
# ---------- end ghpython_script_2 ----------

# ---- group: MIT grasp end effector
# visual model
mesh = Mesh([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])

# ----
mesh_2 = Mesh(ghpython_script_2.collision_mesh)
mesh_3 = Mesh(mesh)
mesh_4 = Mesh(mesh_2)

# ----
# TCP Calibration Point
point_7 = Point(Point(-2.851003028, 1.035000463, 188.1551834))
point_8 = Point("0,0, 185.795")

# ---- group: caliberated TCP pt
point_9 = Point(point_7)

# ---- group: original visual TCP pt
point_10 = Point(point_7)

# ----
panel_2 = Panel(point_9)
panel_3 = Panel(point_10)

# ----
# original tool tip
# caliberated TCP tip
# the eef frame in the URDF needs to be shifted accordingly!
point_11 = Point(point_9)
point_12 = Point(point_10)
vector_2pt = Vector2Pt(PointA=point_12, PointB=point_11, Unitize=False)  # -> Vector, Length
division_3 = Division(A=vector_2pt.Vector, B="1000")
division_4 = Division(A=point_11, B="1000")
panel_4 = Panel(division_3)
panel_5 = Panel(division_4)

# ----
# Open gripper IO command
panel_6 = Panel("""; open gripper
HALT
$OUT[2] = TRUE
$OUT[5] = FALSE
HALT""")

# ----
# Close gripper IO command
panel_7 = Panel("""; close gripper
HALT
$OUT[2] = FALSE
$OUT[5] = TRUE
HALT""")

text = Text(rhino_doc_dir)
ghpython_script_3 = GhPythonScript(x=text, y="single_tet_regression_solution_20-09-02_20-37-23.json")  # -> out, a
# ---------- ghpython_script_3: Python ----------
import os

a = os.path.join(x, '..', '..', 
    'tests', 'results', y)
# ---------- end ghpython_script_3 ----------
panel_8 = Panel(ghpython_script_3.a)
kuka_prc_custom_krl = KUKAPrcCustomKRL(TextAsKRL=panel_7)
kuka_prc_custom_krl_2 = KUKAPrcCustomKRL(TextAsKRL=panel_6)
reload = BooleanToggle(False)
ghpython_script_4 = GhPythonScript(reload=reload, result_file_path=ghpython_script_3.a, scale="1e3")  # -> out, paths, elements, tags
# ---------- ghpython_script_4: Python ----------
import rhinoscriptsyntax as rs
import Rhino.Geometry.Plane as Plane
import Rhino.Geometry.Point3d as Point3d
import Rhino.Geometry.Vector3d as Vector3d
import Rhino.Geometry.Quaternion as Quat
import Rhino.Geometry.Line as Line
import Grasshopper.DataTree as DataTree # Add, AddRange(list, GHPath(i, j))
import Grasshopper.Kernel.Data.GH_Path as GHPath
import System

from ghpythonlib.treehelpers import list_to_tree, tree_to_list

import json
from compas.geometry import Frame
from compas_ghpython import draw_pipes, draw_frame
from itertools import islice

with open(result_file_path) as json_file:
    data = json.load(json_file)

print('file_name: {}'.format(data['problem']))
try:
    print('write_time: {}'.format(data['write_time']))
except:
    pass
TOL = 1e-3

paths = DataTree[System.Double]()
elements = DataTree[System.Int32]()
tags = DataTree[System.String]()
for seq_id, traj in enumerate(data['plan']):
    path = traj['path']
    for t_id, conf in enumerate(path):
        conf = [float(v) for v in conf]
        paths.AddRange(conf, GHPath(seq_id, t_id))
    if traj['element'] is not None: 
        elements.Add(traj['element'], GHPath(seq_id))
    tags.Add(traj['tag'], GHPath(seq_id))

#transfer_joints = DataTree[System.Double]()
#transit_joints = DataTree[System.Double]()
#pick_approach_joints = DataTree[System.Double]()
#pick_retreat_joints = DataTree[System.Double]()
#place_approach_joints = DataTree[System.Double]()
#place_retreat_joints = DataTree[System.Double]()

#seq_id = 0
#sp_id = 0
#e_id = data['plan'][0]['element']
#for traj in data['plan']:
#    if e_id != traj['element']:
#        e_id = traj['element']
#        seq_id += 1
#        sp_id = 0
#    path = traj['path']
#    for t_id, conf in enumerate(path):
#        conf = [float(v) for v in conf]
#        if traj['tag'] == 'transfer':
#            transfer_joints.AddRange(conf, GHPath(int(seq_id), sp_id, t_id))
#        elif traj['tag'] == 'transit':
#            transit_joints.AddRange(conf, GHPath(int(seq_id), sp_id, t_id))
#        elif traj['tag'] == 'place_approach':
#            place_approach_joints.AddRange(conf, GHPath(int(seq_id), sp_id, t_id))
#        elif traj['tag'] == 'place_retreat':
#            place_retreat_joints.AddRange(conf, GHPath(int(seq_id), sp_id, t_id))
#        else:
#            raise ValueError('tag {} not recognized!'.format(traj['tag']))
#    sp_id += 1
# ---------- end ghpython_script_4 ----------
shift_paths = ShiftPaths(Data=ghpython_script_4.paths, Offset=-1)
tree_statistics = TreeStatistics(Tree=shift_paths)  # -> Paths, Length, Count
partition_list = PartitionList(List=tree_statistics.Paths, Size="4")  # -> simplify(Chunks)
cluster = Cluster_3(branch=partition_list)
panel_9 = Panel(ghpython_script_4.out)
panel_10 = Panel(ghpython_script_4.tags)
panel_11 = Panel(cluster)
list_item = ListItem(List=cluster, Index=0, Wrap=True)  # -> Item, Item1, Item2, Item3
split_tree = SplitTree(Data=ghpython_script_4.paths, Masks=flatten(list_item.Item3))  # -> Positive, Negative
split_tree_2 = SplitTree(Data=ghpython_script_4.paths, Masks=flatten(list_item.Item2))  # -> Positive, Negative
split_tree_3 = SplitTree(Data=ghpython_script_4.paths, Masks=flatten(list_item.Item1))  # -> Positive, Negative
split_tree_4 = SplitTree(Data=ghpython_script_4.paths, Masks=flatten(list_item.Item))  # -> Positive, Negative
transition_joint_speed = Slider(50, range=0..100)
number_2 = Number(split_tree.Positive)
number_3 = Number(split_tree_2.Positive)
number_4 = Number()
number_5 = Number(split_tree_4.Positive)
number_6 = Number()
number_7 = Number(split_tree_3.Positive)
cluster_2 = Cluster(radians=number_5, speed=transition_joint_speed)
cluster_3 = Cluster(radians=number_6, speed=transition_joint_speed)
cluster_4 = Cluster(radians=number_7, speed=transition_joint_speed)
cluster_5 = Cluster(radians=number_2, speed=transition_joint_speed)
cluster_6 = Cluster(radians=number_3, speed=transition_joint_speed)
cluster_7 = Cluster(radians=number_4, speed=transition_joint_speed)

# ---- group: open gripper IO
kuka_prc_command = KUKAPrcCommand(kuka_prc_custom_krl_2)

# ---- group: transit
kuka_prc_command_2 = KUKAPrcCommand(cluster_2)

# ---- group: pick approach
kuka_prc_command_3 = KUKAPrcCommand(cluster_3)

# ---- group: close gripper IO
kuka_prc_command_4 = KUKAPrcCommand(kuka_prc_custom_krl)

# ---- group: place retreat
kuka_prc_command_5 = KUKAPrcCommand(cluster_5)

# ---- group: place approach
kuka_prc_command_6 = KUKAPrcCommand(cluster_6)

# ---- group: transfer
kuka_prc_command_7 = KUKAPrcCommand(cluster_4)

# ---- group: pick retreat
kuka_prc_command_8 = KUKAPrcCommand(cluster_7)

# ----
cluster_8 = Cluster_2(list=cluster_6, list_b=kuka_prc_command)
cluster_9 = Cluster_2(list=kuka_prc_command_2, list_b=kuka_prc_command_4)
merge = Merge(
    Data1=kuka_prc_command_2,
    Data2=cluster_9,
    Data5=kuka_prc_command_7,
    Data7=kuka_prc_command_6,
    Data8=cluster_8,
    Data9=kuka_prc_command_5)
bar_seq_id = Slider(5, range=0..8)
kuka_prc_command_9 = KUKAPrcCommand(merge)
tree_statistics_2 = TreeStatistics(Tree=kuka_prc_command_9)  # -> Paths, Length, Count
integer = Integer(bar_seq_id)
multiplication = Multiplication(A=integer, B="4")
addition_3 = Addition(A=multiplication, B="4")
split_list = SplitList(List=tree_statistics_2.Paths, Index=Slider(20, range=0..100))  # -> ListA, ListB
ghpython_script_5 = GhPythonScript(x=multiplication, y=addition_3)  # -> out, a
# ---------- ghpython_script_5: Python ----------
a = list(range(x,y))
# ---------- end ghpython_script_5 ----------

construct_path = ConstructPath(Indices=graft(ghpython_script_5.a))  # -> flatten(Branch)
split_tree_5 = SplitTree(Data=kuka_prc_command_9, Masks=flatten(split_list.ListB))  # -> Positive, Negative

kuka_prc_command_10 = KUKAPrcCommand(flatten(split_tree_5.Positive))

# ----
# Robot Model
# End effector setup
kuka_agilus_kr6_kr10_r900 = KUKAAgilusKR6KR10R900(highresactive=False, infiniterot=False)

use_collision_ee_model = BooleanToggle(False)

stream_filter = StreamFilter(Gate=use_collision_ee_model, Stream0=mesh_3, Stream1=mesh_4)
move_4 = Move(Geometry=stream_filter, Motion=vector_2pt.Vector)  # -> Geometry, Transform
custom_tool_for_kuka_prc = CustomToolForKUKAPrc(
    CustomToolGeometry=move_4.Geometry,
    toolid=6,
    toolvala=0,
    toolvalb=0,
    toolvalc=0,
    toolvalx=-2.85,
    toolvaly=1.035,
    toolvalz=188.155,
    valuesset=True)

kuka_prc_core = KUKAPrcCORE(
    SimulationSlider=Slider(0.4278, range=0..1),
    KUKAPrcCommands=kuka_prc_command_10,
    KUKAPrcTool=custom_tool_for_kuka_prc,
    KUKAPrcRobot=kuka_agilus_kr6_kr10_r900,
    LINstartspeed=0.1,
    PRC_SaveNameExpose=False,
    PTPstartspeed=5,
    acc_cp=nan,
    acc_ptp=-1,
    basea=0,
    baseb=0,
    basec=0,
    baseindex=0,
    basex=0,
    basey=0,
    basez=0,
    camrobformatting="""&ACCESS RVP
&REL 1
&PARAM TEMPLATE = C:\KRC\Roboter\Template\vorgabe
&PARAM EDITMASK = *
[PROJECTNAME]

[SPLITDEFS]

;FOLD INI
;FOLD BASISTECH INI
GLOBAL INTERRUPT DECL 3 WHEN $STOPMESS==TRUE DO IR_STOPM ( )
INTERRUPT ON 3
BAS (#INITMOV,0 )
;ENDFOLD (BASISTECH INI)
;ENDFOLD (INI)

[STARTAXPOS]

[SETPARAMETERS]

[COMMANDS]

END""",
    camrobon=False,
    checkallcolls=False,
    enda01=5,
    enda02=-90,
    enda03=100,
    enda04=5,
    enda05=10,
    enda06=-5,
    ende01=0,
    ende02=0,
    ende03=0,
    ende04=0,
    endindex=0,
    haltatend=True,
    hash=801,
    initialstatus="110",
    int_advance=-1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)  # -> simplify(RobotGeometry), AnalysisOutput

# ==== cluster Cluster
radians = ClusterInput()
degrees = Degrees(Radians=radians)
list_item = ListItem(List=degrees, Index=0, Wrap=True)  # -> Item, Item1, Item2, Item3, Item4, Item5
speed = ClusterInput()
kuka_prc_axis_movement = KUKAPrcAXISMovement(
    Axis1=list_item.Item,
    Axis2=list_item.Item1,
    Axis3=list_item.Item2,
    Axis4=list_item.Item3,
    Axis5=list_item.Item4,
    Axis6=list_item.Item5,
    Speed=speed,
    extaxenabled=False,
    impedancemode=False,
    interpolation="C_PTP")
shift_paths = ShiftPaths(Data=kuka_prc_axis_movement, Offset=-1)
data = ClusterOutput(shift_paths)

# ==== cluster Cluster_2
list = ClusterInput()
list_item = ListItem(List=list, Index=0, Wrap=True)
list_b = ClusterInput()
longest_list = LongestList(ListListA=list_item, ListListB=list_b, PaddingMode=2)  # -> ListListA, ListListB
list_b_2 = ClusterOutput(longest_list.ListListB)

# ==== cluster Cluster_3
branch = ClusterInput()
deconstruct_path = DeconstructPath(Branch=branch)
shift_paths = ShiftPaths(Data=deconstruct_path, Offset=-1)
concatenate = Concatenate(Fragment_A="{", Fragment_B=shift_paths, A=";*}")
result = ClusterOutput(concatenate)
